# Grasshopper definition robot_playground_ur_arduino.ghx (Grasshopper 1.0.7)
# plug-ins: Firefly.Core

geo = Geometry(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)
pt = Point(Point(0, 0, 73.52667469))
crv = Curve(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)
crv_2 = Curve(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)

# ----
# Steps for connecting to the URs in the ECL
# https://github.com/createchaos/arc_574/blob/main/README.md
# 1. Turn on the robots
# 2. Use visual Studio Code to get Docker Running
# 3. Connect the robots to your computer
# 4. Make sure your IP settings are correct
# 5. Use Anaconda Prompt to activate your environment.
# 6. In grasshopper ROS section: restart, connect, load
# 7. Make sure you are connected to the right robot
# 8. Ping the robots to make sure you are connected
# 9. Send planes
# Load Robot information from ROS
restart = Button()
disconnect = Button()
connect = Button()
ros = PythonScript(ip="127.0.0.1", restart=restart)  # -> out, ros_client
# ---------- ros: Python ----------
import sys
import time
import logging
import scriptcontext as sc

from compas_fab.backends import RosClient

from System import TimeSpan
from System.Threading import ManualResetEventSlim

LOGGER = logging.getLogger('roslibpy')

key = 'rosclient_%s' % str(ghenv.Component.InstanceGuid)
previous_client = sc.sticky.get(key, None)
if previous_client:
    previous_client.terminate()

ros_client = RosClient(ip, 9090)
sc.sticky[key] = ros_client

waitLock = ManualResetEventSlim(False)

ros_client.on_ready(lambda: waitLock.Set())

if not waitLock.Wait(TimeSpan.FromSeconds(5)):
    raise Exception('Unable to connect to ROS')

LOGGER.info('ROS connection opened')
# ---------- end ros ----------
connect_2 = PythonScript(ros_client=ros.ros_client, connect=connect, disconnect=disconnect)  # -> out, ros_client
# ---------- connect_2: Python ----------
import logging
from System import TimeSpan
from System.Threading import ManualResetEventSlim

LOGGER = logging.getLogger('roslibpy')

if connect:
    if not ros_client.is_connected:
        LOGGER.debug('Connecting...')
        waitLock = ManualResetEventSlim(False)
        ros_client.on_ready(lambda: waitLock.Set())
        ros_client.connect()

        if not waitLock.Wait(TimeSpan.FromSeconds(5)):
            raise Exception('Unable to connect to ROS')
        LOGGER.debug('Reconnected')

if disconnect:
    if ros_client.is_connected:
        ros_client.terminate()
        LOGGER.debug('Terminated')

print ros_client.is_connected
# ---------- end connect_2 ----------
is_connected = Panel(connect_2.out)

# ----
# Load a robot from ROS
# (only will work if you have done steps 1-5)
units = ValueList({"m": 1, "cm": 100, "mm": 1000}, selected="mm")
load = Button()
python = PythonScript(client=connect_2.ros_client, scale_factor=units, load=load)  # -> out, robot; inputs load: Boolean
# ---------- python: Python ----------
import os
from scriptcontext import sticky as st
import compas
import compas_fab
from compas.robots import RobotModel
from compas_fab.backends import RosClient
from compas_fab.backends import RosFileServerLoader
from compas_fab.robots import Robot
from compas_fab.robots import RobotSemantics
from compas_ghpython.artists import RobotModelArtist

# Set high precision to import meshes defined in meters
compas.PRECISION = '24f'

# store robot in component
guid = str(ghenv.Component.InstanceGuid)
robot_key = "robot_" + guid

if robot_key not in st:
    st[robot_key] = None

if client and client.is_connected and load:
    # Load URDF from ROS
    loader = RosFileServerLoader(client)
    urdf = loader.load_urdf()
    srdf = loader.load_srdf()

    # Create robot model from URDF and load geometry
    model = RobotModel.from_urdf_string(urdf)
    model.load_geometry(loader)
    
#### new #################
#    robot = client.load_robot()
#    robot.info()
#
#    assert robot.name == 'abb_irb120_3_58'
##########################
    semantics = RobotSemantics.from_srdf_string(srdf, model)

    robot = Robot(model, semantics=semantics)

    robot.artist = RobotModelArtist(robot.model)
    robot.scale(scale_factor)
    st[robot_key] = robot

robot = st[robot_key]
if robot:
    robot.client = client
    
    
    
#with RosClient() as client:
#    urdf = compas_fab.get('universal_robot/ur_description/urdf/ur5.urdf')
#    model = RobotModel.from_urdf_file(urdf)
#    robot = Robot(model, client=client)
#
#    robot.info()
#
#    assert robot.name == 'ur5'
# ---------- end python ----------

# ----
# Load a UR5 example robot
units_2 = ValueList({"m": 1, "cm": 100, "mm": 1000}, selected="mm")
load_2 = Button()
create = PythonScript(scale_factor=units_2, load=load_2)  # -> robot
# ---------- create: Python ----------
import os
from scriptcontext import sticky as st

import compas
from compas_fab.robots.ur5 import Robot
from compas_ghpython.artists import RobotModelArtist

compas.PRECISION = '12f'

# store robot in component
guid = str(ghenv.Component.InstanceGuid)
robot_key = "robot_" + guid

if robot_key not in st:
    st[robot_key] = None

if load:
    robot = Robot(load_geometry=True)
    robot.artist = RobotModelArtist(robot.model)
    st[robot_key] = robot
    robot.scale(scale_factor)

robot = st[robot_key]
# ---------- end create ----------

list = ValueList({"use from ROS": 0, "use example UR5": 1}, selected="use example UR5")
set = PythonScript(robot=create, client=connect_2.ros_client)  # -> robot
# ---------- set: Python ----------
if robot and client:
    robot.client = client
# ---------- end set ----------
filter = StreamFilter(Gate=list, Stream0=python.robot, Stream1=set)
robot = Data(filter)

# ----
# Define a Tool
mesh = MeshBrep(
    Brep=geo,
    Settings={GridMaxCount=0, GridMinCount=16, JaggedSeams=False, MaxEdgeLength=0, MinEdgeLength=0.0001, MinTolerance=0, Refine=True, RefineAngle=0, RelativeTolerance=0.65, SimplePlanes=True, Tolerance=0})
pl = ConstructPlane(Origin=pt, XAxis=crv, YAxis=crv_2)
list_2 = ValueList({"Flip": 0, "No Flip": 1}, selected="Flip")
cluster = Cluster(G_2=mesh, G=pl, B=pl, G_4=list_2, _1=mesh, G_3=list_2)  # -> P_2, P, s_0, s_0_2, s_0_3

# ----
# Check to see
# which port you
# should use in
# the Arduino IDE
# under tools
panel = Panel("4")

# ----
# Toggle to open
# the serial port
# Double click to
# start timer
toggle = BooleanToggle(False)
open_port = OpenClosePort(OpenClosePort=toggle, PortNumber=panel, BaudRate="115200")
panel_2 = Panel(open_port)
timer = Timer(TimerInterval=50, Target=uno_read)  # disabled
uno_read = UnoRead(StartReadingValues=Toggle(False), PortNumber=panel)  # -> AnalogPin0, AnalogPin1, AnalogPin2, AnalogPin3, AnalogPin4, AnalogPin5, DigitalPin2, DigitalPin4, DigitalPin7, StatusMessage
panel_3 = Panel(uno_read.AnalogPin0)
panel_4 = Panel(uno_read.StatusMessage)

info = PythonScript(robot=robot)  # -> out, main_group_name
# ---------- info: Python ----------
if robot:
    robot.info()
    main_group_name = robot.main_group_name
# ---------- end info ----------
panel_5 = Panel(info.out)

# ----
# Simulate arduino using a slider
panel_6 = Panel("0")

# ----
# If there are no values coming from the Arduino
# (you are not connected), Grasshopper will use
# this slider as an input instead.  This is a great
# way to test if your script is working.
number_slider = Slider(26, range=0..100)
data = Data(number_slider)

# ----
# Remap sensor values
dom = ConstructDomain(DomainStart="-50", DomainEnd="50")
dom_2 = ConstructDomain(DomainStart=panel_6, DomainEnd="100")
remap = RemapNumbers(Value=data, Source=dom_2, Target=dom)  # -> Mapped, Clipped

# ----
# Remap sensor values
dom_3 = ConstructDomain(DomainStart="-50", DomainEnd="50")
dom_4 = ConstructDomain(DomainStart="40", DomainEnd="160")
remap_2 = RemapNumbers(Value=uno_read.AnalogPin0, Source=dom_4, Target=dom_3)  # -> Mapped, Clipped

# ----
# Arduino Input
python_2 = GhPythonScript(x=remap_2.Mapped, y=remap.Mapped)  # -> out, a
# ---------- python_2: Python ----------
__author__ = "parascho"
__version__ = "2021.03.13"

import rhinoscriptsyntax as rs

if x:
    a = x
else:
    a = y
# ---------- end python_2 ----------

# ----
# Generate Planes
# Example: Generate planes in grasshopper directly
# Generate planes along a
# curve drawn in Rhino
crv_3 = Curve(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)
pframes = PerpFrames(Curve=crv_3, Count=30, Align=True)  # -> Frames, Parameters
pln = Plane(pframes.Frames)

# ----
# Use slider to step through
# configurations
number_slider_2 = Slider(0, range=0..30)

# ----
# Reset
# Turn On
toggle_2 = BooleanToggle(False)

a6 = Slider(0, range=-360..360)
a1 = Slider(0, range=-360..360)
a4 = Slider(0, range=-360..360)
a5 = Slider(0, range=-360..360)
a2 = Slider(-90, range=-360..360)
a3 = Slider(90, range=-360..360)

# ----
# Reset
# Turn On
toggle_3 = BooleanToggle(False)

# ----
# Forward Kinematics
# You set all the joint values
set_joint_positions = BooleanToggle(False)
jp = GhPythonScript()  # -> joint_positions
# ---------- jp: Python ----------
import math
joint_positions = [-3.136, -0.328, -1.218, 3.129, 0.852, 0.008]
joint_positions = [0] * 6
print joint_positions
# ---------- end jp ----------
forward_kinematics = PythonScript(robot=robot, set_joint_positions=set_joint_positions, joint_positions=jp, a1=a1, a2=a2, a3=a3, a4=a4, a5=a5, a6=a6)  # -> full_configuration, joint_positions; inputs joint_positions: list
# ---------- forward_kinematics: Python ----------
import math
import Grasshopper
from compas.robots import Joint
from compas_fab.robots import Configuration

if set_joint_positions:

    j = 0
    for i in range(ghenv.Component.Params.Input.Count):
        nslider = ghenv.Component.Params.Input[i].Sources[0]
        if nslider.GetType() == Grasshopper.Kernel.Special.GH_NumberSlider:
            nslider.TrySetSliderValue(math.degrees(joint_positions[j]))
            j += 1

if robot:
    joint_positions = [a1, a2, a3, a4, a5, a6]
    joint_positions_rad = [0,0,0,0,0,0]
    joint_types = robot.get_configurable_joint_types()
    for i, joint_type in enumerate(joint_types):
        if joint_type == Joint.REVOLUTE:
            joint_positions_rad[i] = math.radians(joint_positions[i])
    full_configuration = Configuration(joint_positions_rad, joint_types)
    print full_configuration
# ---------- end forward_kinematics ----------

# ----
# Turn timer on
# to continuously update
# configuration
timer_2 = Timer(TimerInterval=50, Target=inverse)  # disabled

# ----
# IP Settings
# You will need to change this on your computer to match.  See instructions doc
server_ip = ValueList({"192.168.10.44", "192.168.10.12", "192.168.10.11", "192.168.10.10", "192.168.10.2", "127.0.0.1", "192.168.10.111"}, selected="192.168.10.44")

# ----
# 192.168.10.10 is the robot closest to the ABBs
# and 192.168.10.11 is the other
ur_ip = ValueList({"192.168.10.10", "192.168.10.20", "192.168.10.11", "192.168.10.12", "127.0.0.1", "192.168.10.111"}, selected="192.168.10.10")

# ----
# Check robot availability
ping = Button()
py = PythonScript(ip=ur_ip, ping=ping)  # -> out, trigger
# ---------- py: Python ----------
from scriptcontext import sticky as st
from ur_fabrication_control.direct_control import is_available

guid = str(ghenv.Component.InstanceGuid)
txt_key = "txt_" + guid
if txt_key not in st:
    st[txt_key] = ""

if ping:
    
    available = is_available(ip)
    
    if available:
        st[txt_key] = "%s is up!" % ip
        trigger = True
    else:
        st[txt_key] = "%s is down!" % ip
        trigger = False

print(st[txt_key])
# ---------- end py ----------
panel_7 = Panel(py.out)

server_port = ValueList({"50000", "50002", "50003", "50004", "50005", "30003"}, selected="50000")
ur_port = ValueList({"30002", "30001"}, selected="30001")
globals = PythonScript(server_address=server_ip, server_port=server_port, ur_ip=ur_ip, ur_port=ur_port, robot=robot)  # inputs server_port: Int32
# ---------- globals: Python ----------
from scriptcontext import sticky as st

st["server_address"] = server_address
st["server_port"] = server_port

st["ur_ip"] = ur_ip
st["ur_port"] = ur_port

st["robot"] = robot


"""
if clear:
    st.clear()
"""
# ---------- end globals ----------

# ----
# Change speed (use caution)
number_slider_3 = Slider(0.02, range=0..0.5)

# ----
# Change speed (use caution)
number_slider_4 = Slider(0.02, range=0..0.5)

send = Button()

send_2 = Button()

# ----
# Example: Generate planes in grasshopper
# and manipulate using feedback
# from arduino
# Generate plane and rotate plane
pln_2 = Plane(Plane(origin=(195.2586876, -153.5850751, 389.3575739), x=(0.7629242826, -0.6339132983, 0.1268876249), y=(-0.2093934589, -0.4279920311, -0.8791912196)))
deplane = DeconstructPlane(Plane=pln_2)  # -> Origin, XAxis, YAxis, ZAxis
rot3d = Rotate3D(Geometry=pln_2, Angle=Slider(-1.15, range=-3.142..3.142), Center=deplane.Origin, Axis=deplane.XAxis)  # -> Geometry, Transform
deplane_2 = DeconstructPlane(Plane=rot3d.Geometry)  # -> Origin, XAxis, YAxis, ZAxis

# ----
# Sensor value
# applied to geometry
# (in this case by shifting
# a plane along it's z-axis)
amp = Amplitude(Vector=deplane_2.ZAxis, Amplitude=python_2.a)
move = Move(Geometry=rot3d.Geometry, Motion=amp)  # -> Geometry, Transform

pln_3 = Plane(move.Geometry)

# ----
# Final planes
# for sending to the robot
# If you make your own planes in a different way,
# plug them into this component
pln_4 = Plane(pln_3)
orient = Orient(Geometry=cluster.s_0_2, Source=cluster.P_2, Target=pln_4)  # -> Geometry, Transform
orient_2 = Orient(Geometry=cluster.s_0_3, Source=cluster.P_2, Target=pln_4)  # -> Geometry, Transform

# ----
# Inverse Kinematics
# You tell the robot where you want it to go
# and it figures out the configuration
avoid_collisions = BooleanToggle(False)
start_configuration = Data(forward_kinematics.full_configuration)
inverse = GhPythonScript(
    reset=Button(),
    run=toggle_2,
    robot=robot,
    group=info.main_group_name,
    planes=orient.Geometry,
    start_configuration=start_configuration,
    avoid_collisions=avoid_collisions)  # -> out, group_configuration, full_configuration, frame, frames; inputs planes: list
# ---------- inverse: Python ----------
"""Calculate the robot's inverse kinematic for a given plane.
    Inputs:
        robot: The robot
        group: str, optional
            The planning group used for calculation. Defaults to the robot's
            main planning group.
        plane: The plane in world coordinate frame to calculate the inverse for.
        start_configuration: :class:`compas_fab.robots.Configuration`, optional
            If passed, the inverse will be calculated such that the calculated
            joint positions differ the least from the start_configuration.
            Defaults to the zero configuration.
        avoid_collisions: bool, optional
            Whether or not to avoid collisions. Defaults to True.
    Output:
        group_configuration: The group configuration
        full_configuration: The full configuration
"""
from __future__ import print_function
import logging

from compas.geometry import Frame
from scriptcontext import sticky

if "start_conf" not in sticky:
    sticky["start_conf"] = start_configuration
if "count" not in sticky:
    sticky["count"] = 0
if sticky["count"] >= len(planes):
    sticky["count"] = 0
if sticky["count"] == 0:
    sticky["start_conf"] = start_configuration

if reset:
#    sticky["start_conf"] = start_configuration
    sticky["count"] = 0
    
LOGGER = logging.getLogger('roslibpy')

count = sticky["count"]
plane = planes[count]
frame = Frame(plane.Origin, plane.XAxis, plane.YAxis)
frames = [frame, Frame(plane.Origin, plane.XAxis, plane.YAxis)]
full_configuration = []
start_conf = sticky["start_conf"]
if run:
    if robot and robot.client:
        if robot.client.is_connected:
            for frame in frames:
                full_configuration.append(robot.inverse_kinematics(frame,
                                                              start_configuration=start_conf,
                                                              group=group,
                                                              return_full_configuration=True,
                                                              options={
                                                                'avoid_collisions':avoid_collisions,
                                                              }))
                if full_configuration:
                    sticky["start_conf"] = full_configuration[0]
                    sticky["count"]+=1
            print(group_configuration)
            
        else:
            print("Robot client is not connected")
else:
    full_configuration = sticky["start_conf"]
# ---------- end inverse ----------

# ----
# Inverse Step
# You tell the robot where you want it to go
# and it figures out the configuration
avoid_collisions_2 = BooleanToggle(False)
start_configuration_2 = Data(forward_kinematics.full_configuration)
inverse_2 = GhPythonScript(
    reset=Button(),
    run=toggle_3,
    robot=robot,
    group=info.main_group_name,
    planes=orient.Geometry,
    start_configuration=start_configuration_2,
    avoid_collisions=avoid_collisions_2,
    index=number_slider_2)  # -> out, group_configuration, full_configuration, frame, frames, plane; inputs planes: list, index: Int32
# ---------- inverse_2: Python ----------
"""Calculate the robot's inverse kinematic for a given plane.
    Inputs:
        robot: The robot
        group: str, optional
            The planning group used for calculation. Defaults to the robot's
            main planning group.
        plane: The plane in world coordinate frame to calculate the inverse for.
        start_configuration: :class:`compas_fab.robots.Configuration`, optional
            If passed, the inverse will be calculated such that the calculated
            joint positions differ the least from the start_configuration.
            Defaults to the zero configuration.
        avoid_collisions: bool, optional
            Whether or not to avoid collisions. Defaults to True.
    Output:
        group_configuration: The group configuration
        full_configuration: The full configuration
"""
from __future__ import print_function
import logging

from compas.geometry import Frame
from scriptcontext import sticky

if "start_conf" not in sticky:
    sticky["start_conf"] = start_configuration
if reset:
    sticky["start_conf"] = start_configuration
#if index == 0:
#    sticky["start_conf"] = start_configuration
    

LOGGER = logging.getLogger('roslibpy')

plane = planes[index]
frame = Frame(plane.Origin, plane.XAxis, plane.YAxis)
frames = [frame, Frame(plane.Origin, plane.XAxis, plane.YAxis)]
full_configuration = []
start_conf = sticky["start_conf"]
if run:
    if robot and robot.client:
        if robot.client.is_connected:
            for frame in frames:
                full_configuration.append(robot.inverse_kinematics(frame,
                                                              start_configuration=start_conf,
                                                              group=group,
                                                              return_full_configuration=True,
                                                              options={
                                                                'avoid_collisions':avoid_collisions,
                                                              }))
                if full_configuration:
                    sticky["start_conf"] = full_configuration[0]
                    
            print(group_configuration)
            
        else:
            print("Robot client is not connected")
# ---------- end inverse_2 ----------

# ----
# Configuration
# Position of all the robots joints based on either
# values you give them or the location you want it to reach
# Select:
# forward kinematics
# inverse kinematics
# inverse step
list_3 = ValueList({"foward_kinematics": 0, "inverse": 1, "inverse step": 2}, selected="foward_kinematics")
filter_2 = StreamFilter(
    Gate=list_3,
    Stream0=forward_kinematics.full_configuration,
    Stream1=inverse.full_configuration,
    Stream2=inverse_2.full_configuration)

# ----
# Send planes to the robot
# Move Joints
# Use forward kinematics to set the value for each joint
# Send these joint values to the robot
list_4 = ValueList({"send all positions": 0, "send only one position": 1}, selected="send only one position")
idx = Slider(0, range=0..100)
config = GhPythonScript()  # -> out, joint_configs
# ---------- config: Python ----------
from compas_fab.robots import Configuration

values=[-0.737876, -1.64531, 1.740348, -0.367801, -0.37385, -0.110741]
joint_configs = [Configuration.from_revolute_values(values)]
# ---------- end config ----------
item = ListItem(List=config.joint_configs, Index=idx, Wrap=True)
filter_3 = StreamFilter(Gate=list_4, Stream0=config.joint_configs, Stream1=filter_2)
movej = PythonScript(joint_configurations=filter_3, velocity=number_slider_3)  # -> urscript, values; inputs joint_configurations: list
# ---------- movej: Python ----------
from ur_fabrication_control.direct_control import URScript
import math


"""
for c in joint_configurations:
    for i,v in enumerate(c.values):
        #print v
        if v>math.pi:
            v-=2*math.pi
        if v<-math.pi:
            v+=2*math.pi
        c.values[i]=v
print joint_configurations
values = joint_configurations[0].values
print([math.degrees(v) for v in values])
"""

#joint_config = ["movej({}, v={})".format(c.values, velocity/10) for c in joint_configurations]

print joint_configurations[0].values
urscript = URScript()
urscript.start()
for jc in joint_configurations:
    urscript.move_joint(jc, velocity)
urscript.end()

urscript = urscript.generate()

print(urscript)
# ---------- end movej ----------
send_3 = GhPythonScript(urscript=movej.urscript, send=send, send_continuous=Toggle(False))  # -> out; inputs send: Boolean
# ---------- send_3: Python ----------
from scriptcontext import sticky as st
from ur_fabrication_control.direct_control import send_script

ur_ip = st["ur_ip"]
ur_port = st["ur_port"]

if send or send_continuous:
    send_script(urscript, ur_ip, ur_port)
# ---------- end send_3 ----------

# ----
# Move Cartesian
# Use inverse kinematics to set a plane and
# send the robot to that plane
idx_2 = Slider(0, range=0..100)
crv_4 = Curve(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)
list_5 = ValueList({"send all positions": 0, "send only one position": 1}, selected="send only one position")
pln_5 = Plane(orient_2.Geometry)
hframes = HorizontalFrames(Curve=crv_4, Count=10)  # -> Frames, Parameters
one_over_x = OneOverX(Value=units)
item_2 = ListItem(List=hframes.Frames, Index=idx_2, Wrap=True)
scale = Scale(Geometry=pln_5, Center=Point(0, 0, 0), Factor=one_over_x)  # -> Geometry, Transform
filter_4 = StreamFilter(Gate=list_5, Stream0=hframes.Frames, Stream1=scale.Geometry)
radius = Slider(0.5, range=0..0.5)
movel = PythonScript(planes_WCS=filter_4, velocity=number_slider_4, radius=radius)  # -> urscript; inputs planes_WCS: list
# ---------- movel: Python ----------
import Rhino.Geometry as rg
from compas.geometry import Frame
from compas.geometry import Transformation, Rotation
from compas_ghpython import draw_frame
from compas_fab.robots import robot
from ur_fabrication_control import direct_control 
import math

from scriptcontext import sticky as st
from ur_fabrication_control.direct_control import URScript

robot = st["robot"]

# retrieve the current tool frame in axis angle format
if robot.attached_tool:
    tool_angle_axis = list(robot.attached_tool.frame.point) + list(robot.attached_tool.frame.axis_angle_vector)
else:
    tool0_frame = Frame([0, 0, 0], [1, 0, 0], [0, 1, 0])
    tool_angle_axis = list(tool0_frame.point) + list(tool0_frame.axis_angle_vector)

frames_RCS = []
for plane_WCS in planes_WCS:
    frame_WCS = Frame(plane_WCS.Origin, plane_WCS.XAxis, plane_WCS.YAxis)
    frame_RCS = robot.to_local_coordinates(frame_WCS)
    frames_RCS.append(frame_RCS)

urscript = URScript()
urscript.start()
urscript.moves_linear(frames_RCS, velocity, radius)
urscript.end()

urscript = urscript.generate()

print(urscript)
# ---------- end movel ----------
send_4 = GhPythonScript(urscript=movel, send=send_2, send_continuous=Toggle(False))  # -> out; inputs send: Boolean; same code as send_3

# ----
# Visualize Robots
number_slider_5 = Slider(0, range=0..1)
show_end_effector_frame = BooleanToggle(True)
show_base_frame = BooleanToggle(True)
show_collision = BooleanToggle(False)
show_frames = BooleanToggle(False)
show_visual = BooleanToggle(True)
data_2 = Data(info.main_group_name)
visualize = PythonScript(
    robot=robot,
    group=data_2,
    full_configuration=filter_2,
    int_configuration=number_slider_5,
    show_visual=show_visual,
    show_collision=show_collision,
    show_frames=show_frames,
    show_base_frame=show_base_frame,
    show_end_effector_frame=show_end_effector_frame)  # -> out, visual, collision, frames, base_frame_WCF, ee_frame_WCF, ee_plane; inputs full_configuration: list, int_configuration: Int32
# ---------- visualize: Python ----------
"""Calculates a cartesian motion path (linear in tool space).
    Inputs:
        robot: The robot
        group: str
            The planning group used for visualisation
        full_configuration: :class:`compas_fab.robots.Configuration`
            The robot's full configuration to display.
        show_visual: bool
           Whether or not to show the robot's visual meshes.
        show_collision: bool
           Whether or not to show the robot's collision meshes.
        show_frames: bool
           Whether or not to show the robot's joint frames.
        show_base_frame: bool
           Whether or not to show the robot's base frame.
        show_end_effector_frame: bool
            Whether or not to show the robot's end-effector frame.
    Output:
        visual: The robot's visual meshes.
        collision: The robot's collision meshes.
        frames: The robot's joint frames.
        base_frame_WCF: The robot's base frame.
        ee_frame_WCF: The robot's end-effector frame.
"""
from __future__ import print_function
full_configuration = full_configuration[int_configuration]
import compas_ghpython as cgh

if robot and full_configuration:
    robot.update(full_configuration, group=group, visual=show_visual, collision=show_collision)

    print(full_configuration)

    if show_visual:
        visual = robot.draw_visual()

    if show_collision:
        collision = robot.draw_collision()

    if show_frames:
        axes = robot.transformed_axes(full_configuration)
        frames = robot.transformed_frames(full_configuration)

    if show_base_frame:
        base_frame_WCF = robot.get_base_frame(group, full_configuration)

    if show_end_effector_frame:
        ee_frame_WCF = robot.get_end_effector_frame(group, full_configuration)
        print("End-effector", ee_frame_WCF)
        
        ee_plane = cgh.draw_frame(ee_frame_WCF)
# ---------- end visualize ----------
panel_8 = Panel(visualize.out)
py_2 = PythonScript(robot=robot)  # -> scale
# ---------- py_2: Python ----------
if robot:
    scale = robot.scale_factor * 0.1
else:
    scale = 1.
# ---------- end py_2 ----------
draw = GhPythonScript(frames=[visualize.frames, visualize.ee_frame_WCF, visualize.base_frame_WCF], scale=py_2)  # -> P, V, C, W; inputs frames: list
# ---------- draw: Python ----------
from System.Drawing import Color
from compas_ghpython import draw_frame

red = Color.FromArgb(255, 0, 0)
green = Color.FromArgb(0, 255, 0)
blue = Color.FromArgb(0, 0, 255)

P = []
V = []
C = []

scale = float(scale)

for frame in frames:
    if not frame:
        continue
    plane = draw_frame(frame)
    P += [plane.Origin] * 3
    V.append(plane.XAxis * scale)
    V.append(plane.YAxis * scale)
    V.append(plane.ZAxis * scale)
    C += [red, green, blue]

W = 3
# ---------- end draw ----------
geo_2 = Geometry(visualize.visual)
geo_3 = Geometry(visualize.collision)
vdisex = VectorDisplayEx(Point=draw.P, Vector=draw.V, Colour=draw.C, Width=draw.W)
geo_4 = Geometry(cluster.s_0)
pln_6 = Plane(visualize.ee_plane)
orient_3 = Orient(Geometry=geo_4, Source=cluster.P_2, Target=pln_6)  # -> Geometry, Transform
preview = CustomPreview(Geometry=geo_2, Shader=ColourSwatch(SwatchColor=RGBA(0, 0, 0, 219)))
preview_2 = CustomPreview(Geometry=orient_3.Geometry, Shader=ColourSwatch(SwatchColor=RGBA(20, 156, 255, 120)))

# ==== cluster Cluster
xy = XYPlane(Origin=Point(0, 0, 0))
yz = YZPlane(Origin=Point(0, 0, 0))
P = ClusterOutput(yz)
P_2 = ClusterOutput(xy)
G = ClusterInput()
G_2 = ClusterInput()
orient = Orient(Geometry=G_2, Source=xy, Target=yz)  # -> Geometry, Transform
orient_2 = Orient(Geometry=G, Source=xy, Target=yz)  # -> Geometry, Transform
B = ClusterInput()
G_3 = ClusterInput()
G_4 = ClusterInput()
_1 = ClusterInput()
orient_3 = Orient(Source=xy, Target=orient_2.Geometry)  # -> Geometry, Transform
orient_4 = Orient(Source=xy, Target=B)  # -> Geometry, Transform
orient_5 = Orient(Source=xy, Target=G)  # -> Geometry, Transform
filter = StreamFilter(Gate=G_4, Stream0=orient.Geometry, Stream1=_1)
inverse = InverseTransform(Transform=orient_3.Transform)
inverse_2 = InverseTransform(Transform=orient_4.Transform)
inverse_3 = InverseTransform(Transform=orient_5.Transform)
s_0 = ClusterOutput(filter)
transform = Transform(Geometry=xy, Transform=inverse)
transform_2 = Transform(Geometry=xy, Transform=inverse_2)
filter_2 = StreamFilter(Gate=G_3, Stream0=transform, Stream1=transform_2)
s_0_2 = ClusterOutput(filter_2)
transform_3 = Transform(Geometry=xy, Transform=inverse_3)
filter_3 = StreamFilter(Gate=G_3, Stream0=transform_3, Stream1=transform_2)
s_0_3 = ClusterOutput(filter_3)
